# Grasshopper definition 声程差研究.gh (Grasshopper 0.9.76)
# plug-ins: Python Interpreter

number_slider = Slider(144, range=0..10000)
number_slider_2 = Slider(144, range=0..10000)
Y = UnitY(Factor=1)
声源点 = Point(<point referenced from the Rhino model>)
Y_2 = UnitY(Factor=1)
声源点_2 = Point(<point referenced from the Rhino model>)
line = LineSDL(Start=声源点, Direction=Y, Length=expr("-x", number_slider))
pt = Point(<point referenced from the Rhino model>)
pt_2 = Point(<point referenced from the Rhino model>)
pt_3 = Point(<point referenced from the Rhino model>)
pt_4 = Point(<point referenced from the Rhino model>)
line_2 = LineSDL(Start=声源点, Direction=Y, Length=number_slider)
number_slider_3 = Slider(200, range=0..1000)
crv = Curve(<curve referenced from the Rhino model>)
Z = UnitZ(Factor=Slider(200, range=0..1000))
line_3 = LineSDL(Start=声源点_2, Direction=Y_2, Length=expr("-x", number_slider_2))
pt_5 = Point(<point referenced from the Rhino model>)
pt_6 = Point(<point referenced from the Rhino model>)
pt_7 = Point(<point referenced from the Rhino model>)
pt_8 = Point(<point referenced from the Rhino model>)
line_4 = LineSDL(Start=声源点_2, Direction=Y_2, Length=number_slider_2)
Y_3 = UnitY(Factor=Slider(200, range=0..1000))
crv_2 = Curve(<curve referenced from the Rhino model>)
join = JoinCurves(Curves=[line_2, line], Preserve=False)
extr = Extrude(Base=crv, Direction=Z)
Z_2 = UnitZ(Factor=Slider(200, range=0..1000))
Z_3 = UnitZ(Factor=expr("-x*0.5", number_slider_3))
merge = Merge(Data3=pt_2)  # -> flatten(Result)
join_2 = JoinCurves(Curves=[line_4, line_3], Preserve=False)
Z_4 = UnitZ(Factor=number_slider_3)
extr_2 = Extrude(Base=crv_2, Direction=Y_3)
Z_5 = UnitZ(Factor=1)
vec = Vector(Vector(10.25222123, 616.0224665, 0))
merge_2 = Merge(Data1=pt_5)  # -> flatten(Result)
角点1 = Point(<point referenced from the Rhino model>)
角点2 = Point(<point referenced from the Rhino model>)
move = Move(Geometry=join_2, Motion=Z_3)  # -> Geometry, Transform
反射次数 = Slider(2, range=0..30)
extr_3 = Extrude(Base=join, Direction=Z_2)
Z_6 = UnitZ(Factor=1)
vec_2 = Vector(Vector(10.25222123, 616.0224665, 0))
角点1_2 = Point(<point referenced from the Rhino model>)
角点2_2 = Point(<point referenced from the Rhino model>)
反射次数_2 = Slider(2, range=0..30)
extr_4 = Extrude(Base=move.Geometry, Direction=Z_4)
ln = Line(StartPoint=角点2, EndPoint=pt)
ln_2 = Line(StartPoint=角点1, EndPoint=pt)
ln_3 = Line(StartPoint=角点2_2, EndPoint=pt_5)
ln_4 = Line(StartPoint=角点1_2, EndPoint=pt_5)
vrot = Rotate(Vector=vec, Axis=Z_5, Angle=degrees(Slider(38, range=0..360)))
python = PythonScript(vec_range1=角点1, vec_range2=角点2, vec=vrot, bd=extr, pts=merge, dst=extr_3, boun_num=反射次数, voice_o=声源点)  # -> out, pointo, veco, dpoint, lineo; inputs vec_range1: Point3d, vec_range2: Point3d, vec: Vector3d, bd: Brep, pts: list of Point3d, dst: Brep, boun_num: Int32, voice_o: Point3d
# ---------- python: Python ----------
import GhPython as gp
import Rhino.Geometry as rg
import Grasshopper
import rhinoscriptsyntax as rs

from Grasshopper.Kernel.Types import GH_LineCharge

def distance(point,angle):
    line = rs.AddCurve((point.points[-1],point.points[-2]))
    pd = rs.CurveBrepIntersect(line,dst)#最后一次射线
    if pd:#存在交点
        pd = rs.PointAdd(pd[1][-1],[0,0,0]);#转换成普通点
        return(rs.VectorCreate(voice_o,pd))#返回从交点发出到声源的向量
    else:#不存在
        return(0);

def divi_angle(vec_ran1,vec_ran2,point):#多角度
    vec1 = rs.VectorCreate(vec_ran1,point)#左边界
    vec2 = rs.VectorCreate(vec_ran2,point)#右边界
    vec_divi = []#储存分开后的向量
    x = rs.VectorAngle(vec1,vec2)
    for i in range(0,int(x)+5,1):
        vec_divi.append(rs.VectorRotate(vec1, -i, [0,0,1])*10)
    return(vec_divi)

#divi_angle(vec_range1,vec_range2,e1.voicepoints[0].points[0])

class voicep():
    def __init__(self,pos,vec):
        self_exit_t = 0;#存在的时长
        self_strength = 100;#强度
        self.vec = vec;#现在速度
        self.points = [pos];#交点们,现在位置在point的位置-1
        
    def update(self,r):#检查反射面，并改变起点和方向
        self.pos1 = rg.Point3d.Add(self.points[-1],self.vec);#将要到达的点
        line = rs.AddCurve((self.pos1,self.points[-1]))
        if (r == 0):
            
            pd = rs.CurveBrepIntersect(line, bd)[1][-1];#交点可能有多个，取最近一个
            
        else :
            
            print(rs.CurveBrepIntersect(line, bd))
            pd = rs.CurveBrepIntersect(line, bd)[1][-2]#倒数第二个交点最近

        pd = rs.PointAdd(pd,[0,0,0]);#guid的点转换成rg的点
        self.points.append(pd);#把交点加入list

        normal = rs.BrepClosestPoint(bd, pd)[3];#法线
        xform = rs.XformMirror(pd, normal);
        self.vec = rs.VectorTransform(self.vec,xform);#翻转前进方向

    def check_dest(self):#检查终点
        #pd = 0;
        self.pos1 = rg.Point3d.Add(self.points[-1],self.vec);#将要到达的点
        line = rs.AddCurve((self.pos1,self.points[-1]));
        pd = rs.CurveBrepIntersect(line, dst)[1][0];#与终点面交点
        pd = rs.PointAdd(pd,[0,0,0]);#guid的点转换成rg的点
        self.points.append(pd);#把交点加入list
        print(pd);
        return(pd);



class Engine:
    """
    定义一个引擎，用来初始化移动者，墙体，吸引点，和驱动整个程序的运行。
    """
    def __init__(self,pts):
        """
        param:
            self.voicepoints是一个列表，用来存放所有的voicepoints
        """
        
        self.voicepoints =  Engine.creat_voicepoints(self,pts,vec);#定义点集合

    def creat_voicepoints(self,pts,vec):
            L = []
            for i in range(len(pts)):
                V = []
                V = divi_angle(vec_range1,vec_range2,pts[i]);
                for j in range(len(V)):
                    mover = voicep(pts[i],V[j]);
                    L.append(mover)
            return L

    def update_voicepoints(self,i):
            """
            更新所有移动者的状态值
            """
            lun = i #第lun轮更新
            for mover in self.voicepoints:
                print(lun)
                mover.update(lun)

    
    def creat_line(self):
        line = []
        for mover in self.voicepoints:
            line.append(rs.AddPolyline(mover.points))
        return (line)

        
    def get(self):
            """
            以元组形式返回，移动者的位置和方向
            """
            pts = [mover.pos for mover in self.voicepoints]
            vecs = [mover.vec for mover in self.voicepoints]
            return pts,vecs

e1 = Engine(pts);#实例化一个engin
for i in range(boun_num):
    e1.update_voicepoints(i);#根据反射次数boun_num更新点
    k = []
    p = []
    for mover in e1.voicepoints:
        p.append(mover.points[-1])
        k.append(mover.vec)
    dpoint = p
    veco = k
    

lineo = e1.creat_line();#连接点形成声线



distance(e1.voicepoints[0],50)
# ---------- end python ----------
vdis = VectorDisplay(Anchor=python.dpoint, Vector=python.veco)
vrot_2 = Rotate(Vector=vec_2, Axis=Z_6, Angle=degrees(Slider(38, range=0..360)))
python_2 = PythonScript(vec_range1=角点1_2, vec_range2=角点2_2, vec=vrot_2, bd=extr_2, pts=merge_2, dst=extr_4, boun_num=反射次数_2, voice_o=声源点_2)  # -> out, pointo, veco, dpoint, lineo; inputs vec_range1: Point3d, vec_range2: Point3d, vec: Vector3d, bd: Brep, pts: list of Point3d, dst: Brep, boun_num: Int32, voice_o: Point3d
# ---------- python_2: Python ----------
import GhPython as gp
import Rhino.Geometry as rg
import Grasshopper
import rhinoscriptsyntax as rs

from Grasshopper.Kernel.Types import GH_LineCharge

def distance(point):
    line = rs.AddCurve((point.points[-1],point.points[-2]))
    pd = rs.CurveBrepIntersect(line,dst)#最后一次射线
    if pd:#与舞台幕存在交点
        pd = rs.PointAdd(pd[1][-1],[0,0,0]);#转换成普通点
        return(rs.VectorCreate(voice_o,pd))#返回从交点发出到声源的向量
    else:#不存在
        return(-1);

def divi_angle(vec_ran1,vec_ran2,point):#多角度
    vec1 = rs.VectorCreate(vec_ran1,point)#左边界
    vec2 = rs.VectorCreate(vec_ran2,point)#右边界
    vec_divi = []#储存分开后的向量
    x = rs.VectorAngle(vec1,vec2)
    for i in xrange(0,float(x),d):
        vec_divi.append(rs.VectorRotate(vec1, -i, [0,0,1])*10)
    vec_divi.append(vec2*10)
    return(vec_divi)

#divi_angle(vec_range1,vec_range2,e1.voicepoints[0].points[0])

class voicep():
    def __init__(self,pos,vec):
        self.diff = -1;#存在的时长
        self.vec = vec;#现在速度
        self.points = [pos];#交点们,现在位置在point的位置-1
        
    def update(self,r):#检查反射面，并改变起点和方向
        self.pos1 = rg.Point3d.Add(self.points[-1],self.vec);#将要到达的点
        line = rs.AddCurve((self.pos1,self.points[-1]))
        
        pd = rs.CurveBrepIntersect(line, bd)
        
        print(self.vec)
        if((not pd)or(r>0 and len (pd[1]) < 2)):#没有交点的情况
            
            self.points.append(rs.PointAdd(self.pos1,[0,0,0]))
            """
            global r0,r1
            if r==0 :r0 = r0+1
            if r==1 :r1 = r1+1
            print (r0,"     ",r1)
            """
            return
        pd = pd[1]
        if (r == 0):#第一轮update，交点没有自己
                pd = pd[-1];#交点可能有多个，取最近一个
        else:#后面几轮

            if (len(pd) > 1):
                #print(rs.CurveBrepIntersect(line, bd))
                pd = pd[-2]#倒数第二个交点最近
            else :
                pd = pd[-1];#交点可能有多个，取最近一个
           

        pd = rs.PointAdd(pd,[0,0,0]);#guid的点转换成rg的点
        self.points.append(pd);#把交点加入list
        print(pd)

        normal = rs.BrepClosestPoint(bd, pd)[3];#法线
        xform = rs.XformMirror(pd, normal);
        self.vec = rs.VectorTransform(self.vec,xform);#翻转前进方向
        print(self.vec)





class Engine:
    """
    定义一个引擎，用来初始化移动者，墙体，吸引点，和驱动整个程序的运行。
    """
    def __init__(self,pts):
        """
        param:
            self.voicepoints是一个列表，用来存放所有的voicepoints
        """
        
        self.voicepoints =  Engine.creat_voicepoints(self,pts,vec);#定义点集合

    def creat_voicepoints(self,pts,vec):
            L = []
            for i in range(len(pts)):
                V = []
                V = divi_angle(vec_range1,vec_range2,pts[i]);
                for j in range(len(V)):
                    mover = voicep(pts[i],V[j]);
                    L.append(mover)
            return L

    def update_voicepoints(self,i):
            """
            更新所有移动者的状态值
            """
            lun = i #第lun轮更新
            for mover in self.voicepoints:
                mover.update(lun)

    def dele_many(self):#删除距离过大的点
        i = -1;
        while(self.voicepoints[i+1]):
            i += 1
            mover = self.voicepoints[i]#每一个不同方向不同地点的点
            #print(distance(mover))
            mover.diff = distance(mover)
            if (mover.diff == -1):
                del(self.voicepoints[i]);
                i = i - 1;
            else:
                print(distance(mover))
            
            
    def creat_line(self):
        line = []
        for mover in self.voicepoints:
            line.append(rs.AddPolyline(mover.points))
        return (line)

        
   

e1 = Engine(pts);#实例化一个engin
for i in range(boun_num):
    e1.update_voicepoints(i);#根据反射次数boun_num更新点
    k = []
    p = []
    for mover in e1.voicepoints:
        p.append(mover.points[-1])
        k.append(mover.vec)
    dpoint = p
    veco = k
    

e1.dele_many()

lineo = e1.creat_line();#连接点形成声线
# ---------- end python_2 ----------
panel = Panel(python.out)
vdis_2 = VectorDisplay(Anchor=python_2.dpoint, Vector=python_2.veco)
panel_2 = Panel(python_2.out)
