# Grasshopper definition 声聚焦研究.gh (Grasshopper 1.0.7)

pt = Point(<point referenced from the Rhino model>)
pt_2 = Point(<point referenced from the Rhino model>)
pt_3 = Point(<point referenced from the Rhino model>)

# ---- group: 一定是一根线(rebuild)
轮廓线 = Curve(<curve referenced from the Rhino model>)

轮廓线_2 = Curve(<curve referenced from the Rhino model>)

轮廓线_3 = Curve(<curve referenced from the Rhino model>)

# ----
fillet = Fillet(Curve=轮廓线, Radius=0.2)
fillet_2 = Fillet(Curve=轮廓线_2, Radius=0.2)
Z = UnitZ(Factor=Slider(200, range=0..1000))
Z_2 = UnitZ(Factor=Slider(200, range=0..1000))
fillet_3 = Fillet(Curve=轮廓线_3, Radius=0.2)
Z_3 = UnitZ(Factor=Slider(200, range=0..1000))
merge = Merge(Data3=pt)  # -> flatten(Result)
merge_2 = Merge(Data3=pt_2)  # -> flatten(Result)
merge_3 = Merge(Data3=pt_3)  # -> flatten(Result)
extr = Extrude(Base=fillet, Direction=Z)
extr_2 = Extrude(Base=fillet_2, Direction=Z_2)
extr_3 = Extrude(Base=fillet_3, Direction=Z_3)
角点1 = Point(<point referenced from the Rhino model>)
角点2 = Point(<point referenced from the Rhino model>)
角点1_2 = Point(<point referenced from the Rhino model>)
角点2_2 = Point(<point referenced from the Rhino model>)
角点1_3 = Point(<point referenced from the Rhino model>)
角点2_3 = Point(<point referenced from the Rhino model>)
声线划分次数 = Slider(1, range=1..20)
声线划分次数_2 = Slider(1, range=1..20)
反射次数 = Slider(2, range=0..4)
反射次数_2 = Slider(2, range=0..4)
声线划分次数_3 = Slider(1, range=1..20)
反射次数_3 = Slider(2, range=0..4)

# ---- group: 剖面声线分析
python = PythonScript(vec_range1=角点1, vec_range2=角点2, bd=extr, pts=merge, boun_num=反射次数, r_dens=声线划分次数)  # -> out, pointo, veco, dpoint, lineo; inputs vec_range1: Point3d, vec_range2: Point3d, bd: Brep, pts: list of Point3d, boun_num: Int32
# ---------- python: Python ----------
import GhPython as gp
import Rhino.Geometry as rg
import Grasshopper
import rhinoscriptsyntax as rs

from Grasshopper.Kernel.Types import GH_LineCharge


def divi_angle(vec_ran1,vec_ran2,point,d):#多角度
    vec1 = rs.VectorCreate(vec_ran1,point)#左边界
    vec2 = rs.VectorCreate(vec_ran2,point)#右边界
    vec_divi = []#储存分开后的向量
    x = rs.VectorAngle(vec1,vec2)
    for i in xrange(0,float(x),d):
        vec_divi.append(rs.VectorRotate(vec1, -i, [0,0,1])*10)
    vec_divi.append(vec2*10)
    return(vec_divi)

#divi_angle(vec_range1,vec_range2,e1.voicepoints[0].points[0])
r0 = 0
r1 = 0

class voicep():
    def __init__(self,pos,vec):
        self_exit_t = 0;#存在的时长
        self_strength = 100;#强度
        self.vec = vec;#现在速度
        self.points = [pos];#交点们,现在位置在point的位置-1
        
        
    def update(self,r):#检查反射面，并改变起点和方向
        self.pos1 = rg.Point3d.Add(self.points[-1],self.vec);#将要到达的点
        line = rs.AddCurve((self.pos1,self.points[-1]))
        
        pd = rs.CurveBrepIntersect(line, bd)
        
        print(self.vec)
        if((not pd)or(r>0 and len (pd[1]) < 2)):#没有交点的情况
            
            self.points.append(rs.PointAdd(self.pos1,[0,0,0]))
            """
            global r0,r1
            if r==0 :r0 = r0+1
            if r==1 :r1 = r1+1
            print (r0,"     ",r1)
            """
            return
        pd = pd[1]
        if (r == 0):#第一轮update，交点没有自己
                pd = pd[-1];#交点可能有多个，取最近一个
        else:#后面几轮

            if (len(pd) > 1):
                #print(rs.CurveBrepIntersect(line, bd))
                pd = pd[-2]#倒数第二个交点最近
            else :
                pd = pd[-1];#交点可能有多个，取最近一个
           

        pd = rs.PointAdd(pd,[0,0,0]);#guid的点转换成rg的点
        self.points.append(pd);#把交点加入list
        print(pd)

        normal = rs.BrepClosestPoint(bd, pd)[3];#法线
        xform = rs.XformMirror(pd, normal);
        self.vec = rs.VectorTransform(self.vec,xform);#翻转前进方向
        print(self.vec)

    def check_dest(self):#检查终点
        #pd = 0;
        self.pos1 = rg.Point3d.Add(self.points[-1],self.vec);#将要到达的点
        line = rs.AddCurve((self.pos1,self.points[-1]));
        pd = rs.CurveBrepIntersect(line, dst)[1][0];#与终点面交点
        pd = rs.PointAdd(pd,[0,0,0]);#guid的点转换成rg的点
        self.points.append(pd);#把交点加入list
        print(pd);
        return(pd);



class Engine:
    """
    定义一个引擎，用来初始化移动者，墙体，吸引点，和驱动整个程序的运行。
    """
    def __init__(self,pts):
        """
        param:
            self.voicepoints是一个列表，用来存放所有的voicepoints
        """
        
        self.voicepoints =  Engine.creat_voicepoints(self,pts,vec);#定义点集合

    def creat_voicepoints(self,pts,vec):
            L = []
            for i in range(len(pts)):
                V = []
                V = divi_angle(vec_range1,vec_range2,pts[i],r_dens);
                for j in range(len(V)):
                    mover = voicep(pts[i],V[j]);
                    L.append(mover)
            return L

    def update_voicepoints(self,i):
            """
            更新所有移动者的状态值
            """
            lun = i #第lun轮更新
            for mover in self.voicepoints:
                mover.update(lun)

    
    def creat_line(self):
        line = []
        for mover in self.voicepoints:
            line.append(rs.AddPolyline(mover.points))
        return (line)

        
    def get(self):
            """
            以元组形式返回，移动者的位置和方向
            """
            pts = [mover.pos for mover in self.voicepoints]
            vecs = [mover.vec for mover in self.voicepoints]
            return pts,vecs

e1 = Engine(pts);#实例化一个engin
for i in range(boun_num):
    e1.update_voicepoints(i);#根据反射次数boun_num更新点
   

lineo = e1.creat_line();#连接点形成声线

k = []
p = []
for mover in e1.voicepoints:
    p.append(mover.points[-1])
    k.append(mover.vec)
dpoint = p
veco = k
# ---------- end python ----------

# ---- group: 平面声线分析
python_2 = PythonScript(vec_range1=角点1_2, vec_range2=角点2_2, bd=extr_2, pts=merge_2, boun_num=反射次数_2, r_dens=声线划分次数_2)  # -> out, pointo, veco, dpoint, lineo; inputs vec_range1: Point3d, vec_range2: Point3d, bd: Brep, pts: list of Point3d, boun_num: Int32; same code as python

# ---- group: 剖面声线分析
python_3 = PythonScript(vec_range1=角点1_3, vec_range2=角点2_3, bd=extr_3, pts=merge_3, boun_num=反射次数_3, r_dens=声线划分次数_3)  # -> out, pointo, veco, dpoint, lineo; inputs vec_range1: Point3d, vec_range2: Point3d, bd: Brep, pts: list of Point3d, boun_num: Int32; same code as python

# ----
panel = Panel(python.out)
crv = Curve(python.lineo)
panel_2 = Panel(python_2.out)
crv_2 = Curve(python_2.lineo)
vdis = VectorDisplay(Anchor=python.dpoint, Vector=python.veco)
panel_3 = Panel(python_3.out)
crv_3 = Curve(python_3.lineo)
vdis_2 = VectorDisplay(Anchor=python_2.dpoint, Vector=python_2.veco)
vdis_3 = VectorDisplay(Anchor=python_3.dpoint, Vector=python_3.veco)
end = EndPoints(Curve=crv)  # -> Start, End
end_2 = EndPoints(Curve=crv_2)  # -> Start, End
end_3 = EndPoints(Curve=crv_3)  # -> Start, End
ln = Line(StartPoint=end.Start, EndPoint=end.End)
ln_2 = Line(StartPoint=end_2.Start, EndPoint=end_2.End)
ln_3 = Line(StartPoint=end_3.Start, EndPoint=end_3.End)
len = Length(Curve=crv)
len_2 = Length(Curve=crv_2)
len_3 = Length(Curve=crv_3)
len_4 = Length(Curve=ln)
len_5 = Length(Curve=ln_2)
len_6 = Length(Curve=ln_3)
subtraction = Subtraction(A=len, B=len_4)
subtraction_2 = Subtraction(A=len_2, B=len_5)
subtraction_3 = Subtraction(A=len_3, B=len_6)
larger = LargerThan(FirstNumber=subtraction, SecondNumber=Slider(17000, range=0..100000))  # -> LargerThan, OrEqualTo
larger_2 = LargerThan(FirstNumber=subtraction_2, SecondNumber=Slider(17000, range=0..100000))  # -> LargerThan, OrEqualTo
larger_3 = LargerThan(FirstNumber=subtraction_3, SecondNumber=Slider(17000, range=0..100000))  # -> LargerThan, OrEqualTo
dispatch = Dispatch(List=crv, DispatchPattern=larger.LargerThan)  # -> ListA, ListB
dispatch_2 = Dispatch(List=crv_2, DispatchPattern=larger_2.LargerThan)  # -> ListA, ListB
dispatch_3 = Dispatch(List=crv_3, DispatchPattern=larger_3.LargerThan)  # -> ListA, ListB
panel_4 = Panel(subtraction)
panel_5 = Panel(subtraction_2)
crv_4 = Curve(dispatch.ListB)
rgb = ColourRGB(Alpha=255, Red=0, Green=0, Blue=0)
rgb_2 = ColourRGB(Alpha=255, Red=0, Green=0, Blue=0)
crv_5 = Curve(dispatch.ListA)
crv_6 = Curve(dispatch_2.ListA)
crv_7 = Curve(dispatch_2.ListB)
crv_8 = Curve(dispatch_3.ListA)
crv_9 = Curve(dispatch_3.ListB)
preview = CustomPreview(Geometry=crv_6, Shader=rgb)
preview_2 = CustomPreview(Geometry=crv_5, Shader=rgb_2)
